# Grasshopper definition Graph.TemperatureRange.ghx (Grasshopper 1.0.7)
# plug-ins: V-Ray For Grasshopper 7

path = FilePath("C:\Users\yukio\Documents\GH-FuncBase\[Graph]\Temperature Range\Liverpool DBT Monthly.csv")
file = ReadFile(File=path, PerLineParse=True)
panel = Panel(file)
data = Data(["Liverpool.Lennon.AP, ENG, GBR", "month,Dry Bulb Temp,Dry Bulb Temp,Dry Bulb Temp,Dry Bulb Temp,Dry Bulb Temp,Dry Bulb Temp,Dry Bulb Temp,", " ,Avg Daily,Avg Daily Low,Avg Daily High,Record Low,Record High,Design Low,Design High,", " ,degrees C,degrees C,degrees C,degrees C,degrees C,degrees C,degrees C,", "1,5.390457,3.3483872,7.435484,-2.0,14.0,-2.0,13.0,", "2,5.7047615,3.0,8.142858,-2.0,14.0,-2.0,13.0,", "3,6.8340054,3.8064516,10.032258,-3.0,15.0,-3.0,13.0,", "4,8.77125,4.516667,12.9,1.0,16.0,1.0,16.0,", "5,11.37715,7.8645163,14.903226,3.0,20.0,3.0,18.0,", "6,14.635694,11.086666,18.2,6.8,28.0,6.8,26.0,", "7,16.600134,13.17742,20.129032,9.0,26.0,9.0,25.0,", "8,15.755241,12.645162,19.025806,8.0,25.0,8.0,24.0,", "9,14.275277,11.3,17.566668,7.0,22.0,7.0,21.0,", "10,11.013038,7.903226,14.0,0.0,19.0,0.0,18.0,", "11,7.995695,5.4066668,10.366667,-1.0,15.0,-1.0,15.0,", "12,5.7831993,3.7741935,7.693548,-9.0,13.0,-9.0,13.0,"])
split = TextSplit(Text=data, Separators=",")  # -> simplify(Result)
lng = ListLength(List=split)  # -> flatten(Length)
bnd = Bounds(Numbers=lng)
dedomain = DeconstructDomain(Domain=bnd)  # -> Start, End
culln = CullNth(List=split, CullFrequency=dedomain.End)
flip = FlipMatrix(Data=culln)  # -> simplify(Data)
panel_2 = Panel(flip)
bang = ExplodeTree(Data=panel_2)  # -> Branch0, Branch1, Branch2, Branch3, Branch4, Branch5, Branch6, Branch7

lng_2 = ListLength(List=bang.Branch1)
dom = ConstructDomain(DomainStart=Slider(4, range=0..10), DomainEnd=expr("x-1", lng_2))
subset = SubList(List=bang.Branch1, Domain=dom, Wrap=True)  # -> List, Index

lng_3 = ListLength(List=bang.Branch2)
dom_2 = ConstructDomain(DomainStart=Slider(4, range=0..10), DomainEnd=expr("x-1", lng_3))
subset_2 = SubList(List=bang.Branch2, Domain=dom_2, Wrap=True)  # -> List, Index

lng_4 = ListLength(List=bang.Branch3)
dom_3 = ConstructDomain(DomainStart=Slider(4, range=0..10), DomainEnd=expr("x-1", lng_4))
subset_3 = SubList(List=bang.Branch3, Domain=dom_3, Wrap=True)  # -> List, Index

lng_5 = ListLength(List=bang.Branch4)
dom_4 = ConstructDomain(DomainStart=Slider(4, range=0..10), DomainEnd=expr("x-1", lng_5))
subset_4 = SubList(List=bang.Branch4, Domain=dom_4, Wrap=True)  # -> List, Index

lng_6 = ListLength(List=bang.Branch5)
dom_5 = ConstructDomain(DomainStart=Slider(4, range=0..10), DomainEnd=expr("x-1", lng_6))
subset_5 = SubList(List=bang.Branch5, Domain=dom_5, Wrap=True)  # -> List, Index

xz = XZPlane(Origin=Point(0, 0, 0))
number_slider = Slider(4, range=0..10)
recgrid = Rectangular(Plane=xz, SizeX=number_slider, SizeY=2, ExtentX="12", ExtentY="1")  # -> Cells, Points
flip_2 = FlipMatrix(Data=recgrid.Points)
lng_7 = ListLength(List=flip_2)
culln_2 = CullNth(List=flip_2, CullFrequency=lng_7)
flip_3 = FlipMatrix(Data=culln_2)
item = ListItem(List=flip_3, Index=0, Wrap=True)
division = Division(A=number_slider, B="2")
X = UnitX(Factor=division)
pt = Point(item)
move = Move(Geometry=pt, Motion=X)  # -> flatten(Geometry), Transform
pdecon = Deconstruct(Point=move.Geometry)  # -> XComponent, YComponent, ZComponent
division_2 = Division(A=Slider(17, range=0..100), B="100")
pt_2 = ConstructPoint(XCoordinate=pdecon.XComponent, YCoordinate=0, ZCoordinate=subset.List)
multiplication = Multiplication(A=division, B=division_2)
pt_3 = Point(pt_2)
box = CenterBox(Base=pt_3, X=multiplication, Y=1, Z=Slider(0.5, range=0..5))

subtraction = Subtraction(A=subset_3.List, B=subset_2.List)
division_3 = Division(A=subtraction, B="2")
number_slider_2 = Slider(0.3, range=0..1)
pt_4 = ConstructPoint(XCoordinate=pdecon.XComponent, YCoordinate=0, ZCoordinate=subset_4.List)
pt_5 = ConstructPoint(XCoordinate=pdecon.XComponent, YCoordinate=0, ZCoordinate=subset_5.List)
sph = Sphere(Base=pt_4, Radius=number_slider_2)
sph_2 = Sphere(Base=pt_5, Radius=number_slider_2)
box_2 = CenterBox(Base=pt_3, X=multiplication, Y=1, Z=division_3)
relay = Relay([sph_2, sph])

timeline = VRayTimeline(FramesCount=Slider(120, range=100..200))  # -> Timeline, CurrentFrame, CurrentFraction

mtl_name = VRayMaterialFromProject(
    "/LED_SuperRed",
    Has_Extract_Parameter=True,
    Has_Manage_Collection=False,
    OptionsLength=15,
    Version=1,
    Options=["/3D_Print_Blue", "/Aluminum_Anodized_Clear", "/Aluminum_Blurry", "/CarPaint_Matte_CapriBlue", "/Chrome_Polished", "/LED_SuperRed", "/LED_SuperRed#1", "/Paper_Lamp_B_20cm", "/Paper_Lamp_B_Back", "/Paper_Lamp_B_Front", "/Plastic_SSS_01_White", "/Plastic_SSS_02_Orange", "/Plastic_Translucent_01_White", "/Plastic_Translucent_02_Orange", "/Plastic_Translucent_03_Green"])

pt_6 = ConstructPoint(XCoordinate=0, YCoordinate=0, ZCoordinate=0)
cosmos = VRayCosmosAsset(
    BasePlane=pt_6,
    Scale=Slider(0.25, range=0..0.5),
    Visible=Toggle(True),
    Lights=Toggle(True),
    IntensityMultiplier=1,
    ColorMultiplier=ColourSwatch(SwatchColor=RGB(255, 255, 255)))  # -> VGeometry, BoundingBox

mtl_name_2 = VRayMaterialFromProject(
    "/Plastic_Translucent_03_Green",
    Has_Extract_Parameter=True,
    Has_Manage_Collection=False,
    OptionsLength=15,
    Version=1,
    Options=["/3D_Print_Blue", "/Aluminum_Anodized_Clear", "/Aluminum_Blurry", "/CarPaint_Matte_CapriBlue", "/Chrome_Polished", "/LED_SuperRed", "/LED_SuperRed#1", "/Paper_Lamp_B_20cm", "/Paper_Lamp_B_Back", "/Paper_Lamp_B_Front", "/Plastic_SSS_01_White", "/Plastic_SSS_02_Orange", "/Plastic_Translucent_01_White", "/Plastic_Translucent_02_Orange", "/Plastic_Translucent_03_Green"])

stereo = Stereo(
    0,
    Has_Extract_Parameter=False,
    Has_Manage_Collection=False,
    OptionsLength=3,
    Version=1,
    Options=["Off", "Side by Side", "Top Bottom"])
type = Type(
    1,
    Has_Extract_Parameter=False,
    Has_Manage_Collection=False,
    OptionsLength=4,
    Version=1,
    Options=["Standard", "Orthographic", "VR Spherical Panorama", "VR Cube Map"])
pt_7 = ConstructPoint(XCoordinate=0, YCoordinate=0, ZCoordinate=0)
pt_8 = ConstructPoint(XCoordinate=0, YCoordinate=0, ZCoordinate=0)
camera = VRayCamera(
    Type=type,
    Stereo=stereo,
    Position=pt_7,
    Target=pt_8,
    FOV=26.99146652,
    Tilt=0,
    OrthographicZoomFactor=0,
    PhysicalExposureOn=Toggle(True),
    WhiteBalance=ColourSwatch(SwatchColor=RGB(255, 255, 255)),
    FNumber=8,
    ShutterSpeed1S=Slider(50, range=0.1..100),
    FilmSensitivity=Slider(1600, range=100..3200),
    AutoExposure=Toggle(False),
    AutoWhiteBalance=Toggle(False),
    DepthOfFieldFocus=0)  # -> Camera, Angle, ExposureValue

gradient = Gradient(
    LowerLimit=0,
    UpperLimit=1,
    Parameter=timeline.CurrentFraction,
    stops=[0: RGB(157, 255, 0), 0.485: RGB(255, 255, 0), 1: RGB(255, 0, 0)])
graph = GraphMapper(
    timeline.CurrentFraction,
    x0=0,
    x1=1.52,
    y0=0,
    y1=1.52,
    container_name="Bezier",
    cpx=[0, 0.326005429, 0.02638938278, 1],
    cpy=[0, 0.04009175301, 0.5269581079, 1])
graph_2 = GraphMapper(
    timeline.CurrentFraction,
    x0=0,
    x1=1,
    y0=19,
    y1=24,
    container_name="Sine Summation",
    Equation0_px=[0.2, 0.4789262116],
    Equation0_py=[0.2, 0.3446460962],
    Equation1_px=[0.1866932809, 0.314386785],
    Equation1_py=[0.4049541354, 0.5476994514])
graph_3 = GraphMapper(
    graph,
    x0=0,
    x1=1.52,
    y0=-19,
    y1=16,
    container_name="Bezier",
    cpx=[0, 0.5474556684, 0.5029165149, 1],
    cpy=[1, 0.03943574429, 0.5637550354, 0.5705647469])

texture = Texture(
    File_Picker=0,
    File_Types="All Image Files (*.png; *.bmp; *.tga; *.hdr; *.sgi; *.rgb; *.rgba; *.jpg; *.jpeg; *.exr; *.pic; *.tif; *.tiff; *.tx)|*.png;*.bmp;*.tga;*.hdr;*.sgi;*.rgb;*.rgba;*.jpg;*.jpeg;*.exr;*.pic;*.tif;*.tiff;*.tx|Portable Network Graphics (*.png)|*.png|Windows bitmap (*.bmp)|*.bmp|Targa Image (*.tga)|*.tga|Radiance High-Dynamyc Range (*.hdr)|*.hdr|Silicon Graphics (*.sgi; *.rgb; *.rgba)|*.sgi;*.rgb;*.rgba|JPEG image (*.jpg; *.jpeg)|*.jpg;*.jpeg|OpenEXR image (*.exr)|*.exr|SoftImage PICT (*.pic)|*.pic|Tagged image (*.tif; *.tiff)|*.tif;*.tiff|Tiled mipmapped image file (*.tx)|*.tx",
    Multiple_Files=True)
rig_dome = VRayLightRigDome(
    LightOn=Toggle(False),
    Visible=Toggle(False),
    Texture=texture,
    Intensity=Slider(0.03, range=0..1),
    Rotation=0,
    BackgroundIntensity=1)

pt_9 = ConstructPoint(XCoordinate=0, YCoordinate=0, ZCoordinate=0)

pt_10 = ConstructPoint(XCoordinate="1", YCoordinate=expr("-x", "1"), ZCoordinate=0)
light_directional = VRayLightDirectional(
    On=Toggle(True),
    Position=pt_10,
    Target=pt_9,
    Color=RGB(255, 255, 255),
    Intensity=Slider(111.5, range=0..3000),
    ShadowSoftness=Slider(0.5, range=0..1))

engine = Engine(
    2,
    Has_Extract_Parameter=False,
    Has_Manage_Collection=False,
    OptionsLength=3,
    Version=1,
    Options=["V-Ray Denoiser", "NVIDIA AI Denoiser", "Intel Open Image Denoiser"])
preset = Preset(
    2,
    Has_Extract_Parameter=False,
    Has_Manage_Collection=False,
    OptionsLength=3,
    Version=1,
    Options=["Mild", "Default", "Strong"])
mode = Mode(
    2,
    Has_Extract_Parameter=False,
    Has_Manage_Collection=False,
    OptionsLength=3,
    Version=1,
    Options=["Only Render Elements", "Hide Denoiser Channel", "Show Denoiser Channel"])
denoiser = VRayElementDenoiser(Engine=engine, Preset=preset, Mode=mode)

dam = DataDam(DataA=denoiser, BufferDelay=10000000, BufferMode=0)

entwine = Entwine(Branch00=box, Branch01=box_2, Branch02=flatten(relay), FlattenInputs=True)

dam_2 = DataDam(DataA=entwine, BufferDelay=10000000, BufferMode=0)

bang_2 = ExplodeTree(Data=dam_2)  # -> Branch0, Branch1, Branch2
vgeo = VRayGeometry(Geo=bang_2.Branch1, Material=mtl_name_2, quality=0)

vgeo_2 = VRayGeometry(Geo=bang_2.Branch2, Material=mtl_name, quality=0)

mtl_name_3 = VRayMaterialFromProject(
    "/Chrome_Polished",
    Has_Extract_Parameter=True,
    Has_Manage_Collection=False,
    OptionsLength=15,
    Version=1,
    Options=["/3D_Print_Blue", "/Aluminum_Anodized_Clear", "/Aluminum_Blurry", "/CarPaint_Matte_CapriBlue", "/Chrome_Polished", "/LED_SuperRed", "/LED_SuperRed#1", "/Paper_Lamp_B_20cm", "/Paper_Lamp_B_Back", "/Paper_Lamp_B_Front", "/Plastic_SSS_01_White", "/Plastic_SSS_02_Orange", "/Plastic_Translucent_01_White", "/Plastic_Translucent_02_Orange", "/Plastic_Translucent_03_Green"])

vgeo_3 = VRayGeometry(Geo=bang_2.Branch0, Material=mtl_name_3, quality=0)

entwine_2 = Entwine(Branch00=vgeo_3, Branch01=vgeo, Branch02=vgeo_2, FlattenInputs=True)

out_img = OutputImage(
    "C:\Users\yukio\Desktop\CubeRender\cube_render.png",
    File_Picker=1,
    File_Types="Portable Network Graphics (*.png)|*.png|Windows bitmap (*.bmp)|*.bmp|Targa Image (*.tga)|*.tga|Radiance High-Dynamyc Range (*.hdr)|*.hdr|Silicon Graphics (*.sgi; *.rgb; *.rgba)|*.sgi;*.rgb;*.rgba|JPEG image (*.jpg; *.jpeg)|*.jpg;*.jpeg|OpenEXR image (*.exr)|*.exr|SoftImage PICT (*.pic)|*.pic|Tagged image (*.tif; *.tiff)|*.tif;*.tiff|Tiled mipmapped image file (*.tx)|*.tx|V-Ray Raw Image (*.vrimg)|*.vrimg",
    Multiple_Files=False)
sampler = Sampler(
    0,
    Has_Extract_Parameter=False,
    Has_Manage_Collection=False,
    OptionsLength=2,
    Version=1,
    Options=["Progressive", "Bucket"])
quality = Quality(
    0,
    Has_Extract_Parameter=False,
    Has_Manage_Collection=False,
    OptionsLength=6,
    Version=1,
    Options=["Low", "Low+", "Medium", "Medium+", "High", "High+"])
engine_2 = Engine(0, Has_Extract_Parameter=False, Has_Manage_Collection=False, OptionsLength=3, Version=1, Options=["CPU", "CUDA", "RTX"])
mode_2 = Mode(
    0,
    Has_Extract_Parameter=False,
    Has_Manage_Collection=False,
    OptionsLength=2,
    Version=1,
    Options=["Interactive", "Production"])
repeat = RepeatData(Data=Slider(480, range=240..2048), Length="2")
render = VRayRender(
    Engine=engine_2,
    Mode=mode_2,
    Sampler=sampler,
    Quality=quality,
    OutputImage=out_img,
    OutputResolution=repeat,
    Camera=camera.Camera,
    LightRig=rig_dome,
    Light=flatten(light_directional),
    VGeometry=flatten(entwine_2),
    Timeline=timeline.Timeline,
    RenderElements=dam,
    UpdateEffectsFrequency=100)

render_in_project = VRayRenderInProject(Scene=render)  # disabled
